# Grasshopper definition 3dcp_Base_GH_Template.gh (Grasshopper 1.0.7)
# plug-ins: KUKA|prc - parametric robot control, DendroGH

# ----
# Concrete Printing
# Environment
# 1. SETUP
world_collision = Mesh(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)
# 工作區域
shelf_collision = Mesh(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)
mjoin = MeshJoin(Meshes=[world_collision, shelf_collision])
world_visual = Mesh([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])
collision = Mesh(mjoin)

# ----
# Robot Workspace
selected_plane = ValueList({"PlaneO": 0, "PlaneA": 1, "PlaneB": 2}, selected="PlaneB")
correction = Slider(10, range=0..50)

# ----
# Tool
探針 = Slider(40, range=0..100)
addition = Addition(A=探針, B="-730.795")
frame = FrameKUKAPrc(FrameNumber=0, XValue=addition, YValue="-3.746", ZValue="163.803", AValue="0", BValue="180", CValue="90", toolaxis="X")  # -> KUKAPrcFrame, XYZABCAsPlane
mesh = Mesh(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)
custom_tool_pln = CustomToolPlaneKUKAPrc(ToolGeometry=mesh, ToolNumber="9", ToolPlane=frame.XYZABCAsPlane, frameinput=False)

# ----
# Safe Working Area
panel = Panel("-1100")
frame_2 = FrameKUKAPrc(FrameNumber=0, XValue=panel, YValue="140", ZValue="-480", AValue=0, BValue=0, CValue=0, toolaxis="Z")  # -> KUKAPrcFrame, XYZABCAsPlane
box = DomainBox(Base=frame_2.XYZABCAsPlane, X="3000", Y="2000", Z="6000")

# ----
# SETUP
io = IO()  # -> _0, _1, _2, _3

# ----
# Raccoon KUKA Robot Cell Template
# Robot
cluster = Cluster()  # -> robot, robot_2

cluster_2 = Cluster_2(data=selected_plane, O=correction, X=Slider(0, range=-300..300))  # -> G, srf_2, C
# 2. OPERATIONS
digout03_on = Data(io._3)
digout02_on = Data(io._2)
pt = Point(Tree({0}: [Point(262.4555358, 5.981370935, 1780), Point(262.1752464, 14.71384779, 1780), Point(244.4031929, 17.09032763, 1780), Point(265.843964, 33.78666302, 1780), Point(254.2690043, 38.6239995, 1780), Point(260.4794909, 51.19125446, 1780)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], {1}: [Point(261.1666836, 6.193825297, 1790), Point(244.8507529, 8.550368467, 1790), Point(266.3504193, 24.08770887, 1790), Point(270.3209258, 34.10875756, 1790), Point(263.5206236, 42.90107063, 1790), Point(255.3839907, 49.30304809, 1790)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], {2}: [Point(260.054686, 6.480689931, 1800), Point(259.761918, 15.28649395, 1800), Point(259.2330797, 24.07559819, 1800), Point(258.464433, 32.83837472, 1800), Point(253.3654397, 40.8672508, 1800), Point(255.4399198, 50.1282712, 1800)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]))
pt_2 = Point(Tree({0}: [Point(259.1199374, 6.819368235, 1810), Point(244.8507529, 8.550368467, 1810), Point(258.2727465, 24.49655171, 1810), Point(257.4928867, 33.29909917, 1810), Point(256.473114, 42.06461335, 1810), Point(255.0647397, 50.7728427, 1810)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], {1}: [Point(258.3624371, 7.204292759, 1820), Point(258.0451167, 16.09750545, 1820), Point(244.4031929, 17.09032763, 1820), Point(256.6883576, 33.81867812, 1820), Point(255.6531067, 42.62672029, 1820), Point(254.3786271, 51.38665838, 1820)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], {2}: [Point(257.7821409, 7.629750104, 1830), Point(257.4504733, 16.57309915, 1830), Point(256.8746549, 25.49706195, 1830), Point(243.6578644, 25.60947301, 1830), Point(254.9987305, 43.24579271, 1830), Point(253.7045289, 52.05053508, 1830)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], {3}: [Point(257.3790955, 8.089779589, 1840), Point(257.0318436, 17.08745834, 1840), Point(256.4374835, 26.06472505, 1840), Point(255.5979218, 35.01096369, 1840), Point(242.6156769, 34.09740906, 1840), Point(253.1949177, 52.76909175, 1840)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], {4}: [Point(257.1532788, 8.578124641, 1850), Point(256.7894327, 17.6342978, 1850), Point(256.1753094, 26.66893686, 1850), Point(255.3129926, 35.67118024, 1850), Point(254.2053157, 44.63033223, 1850), Point(241.2779, 42.54380035, 1850)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], {5}: [Point(256.6813227, 9.073234601, 1860), Point(256.3007888, 18.17698982, 1860), Point(255.6672499, 27.25813018, 1860), Point(254.782851, 36.30548741, 1860), Point(253.6506244, 45.30817835, 1860), Point(258.2320809, 54.96651193, 1860)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]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))
bbox = BoundingBox(Content=flatten(pt), Plane=PlaneXY(0, 0, 0), UnionBox=True)  # -> Box, Box_2
group = Group(Objects=pt_2)
group_2 = Group(Objects=pt)
box_2 = EvaluateBox(Box=bbox.Box, UParameter="0.5", VParameter="0.5", WParameter="0")  # -> Plane, Point, Include
plane = Plane(cluster_2.G)
xy = XYPlane(Origin=box_2.Plane)
orient = Orient(Geometry=group, Source=xy, Target=plane)  # -> Geometry, Transform
orient_2 = Orient(Geometry=group_2, Source=xy, Target=plane)  # -> Geometry, Transform
ungroup = Ungroup(Group=orient.Geometry)
xy_2 = XYPlane(Origin=ungroup)
tstat = TreeStatistics(Tree=xy_2)  # -> Paths, Length, Count

# ----
# 列印速度
列印速度_m_sec = Slider(0.15, range=0..1)

item = ListItem(List=tstat.Paths, Index=0, Wrap=True)  # -> Item1, Item
branch = TreeBranch(Tree=xy_2, Path=item.Item, MaintainPaths=True)
branch_2 = TreeBranch(Tree=xy_2, Path=item.Item1, MaintainPaths=True)
flatten = FlattenTree(Tree=xy_2, Path="{0}")
python = GhPythonScript(plane=flatten)  # -> plane, startPt, endPt; inputs plane: list of Plane
# ---------- python: Python ----------
import rhinoscriptsyntax as rs

plane = plane
a = len(plane) - 1

startPt = plane[0]
endPt = plane[a]
# ---------- end python ----------
X = UnitX(Factor="-200")
Z = UnitZ(Factor="100")
move = Move(Geometry=python.endPt, Motion=X)  # -> Geometry, Transform
預設填料點 = Plane(Plane(origin=(-837.4158325, 606.9471436, -70.23432159), x=(0.7511875281, -0.6597975782, -0.01960748343), y=(0.6597758639, 0.7495853845, 0.05308069962)))
move_2 = Move(Geometry=python.startPt, Motion=Z)  # -> Geometry, Transform
merge = Merge(Data1=move.Geometry, Data2=預設填料點)
filter = StreamFilter(Gate=selected_plane, Stream1=Slider(900, range=0..10000), Stream2=Slider(300, range=0..10000))
lin_move = LINearMovementKUKAPrc(TargetAsPlane=branch, Speed=列印速度_m_sec, ExternalAxis1=filter, extaxenabled=True, interpolation="C_VEL")
lin_move_2 = LINearMovementKUKAPrc(TargetAsPlane=branch_2, ExternalAxis1=filter, extaxenabled=True, interpolation="C_VEL")
lin_move_3 = LINearMovementKUKAPrc(
    TargetAsPlane=move_2.Geometry,
    Speed=Slider(0.05, range=0..0.1),
    ExternalAxis1=filter,
    extaxenabled=True,
    interpolation="C_VEL")
lin_move_4 = LINearMovementKUKAPrc(TargetAsPlane=python.startPt, Speed=列印速度_m_sec, ExternalAxis1=filter, extaxenabled=True, interpolation="C_VEL")
lin_move_5 = LINearMovementKUKAPrc(TargetAsPlane=python.plane, Speed=列印速度_m_sec, ExternalAxis1=filter, extaxenabled=True, interpolation="C_VEL")
# OPERATIONS
lin_move_6 = LINearMovementKUKAPrc(TargetAsPlane=merge, Speed=列印速度_m_sec, ExternalAxis1=filter, extaxenabled=True, interpolation="C_VEL")
開始出料 = Data(io._1)
停止出料 = Data(io._0)
entwine = Entwine(
    Branch00=lin_move_3,
    Branch01=lin_move_4,
    Branch02=lin_move,
    Branch03=開始出料,
    Branch04=lin_move_5,
    Branch05=停止出料,
    Branch06=lin_move_2,
    Branch07=lin_move_6,
    FlattenInputs=True)
data = Data(flatten(entwine))
dam = DataDam(DataA=data, BufferDelay=10000000, BufferMode=0)

# ----
# 3. Simulation, Analysis, Post-Processing
# West Robot
number_slider = Slider(0, range=0..1)
save_krl_file = Button()
python_2 = GhPythonScript(plane=selected_plane, speed=列印速度_m_sec, save=save_krl_file)  # -> save, name; inputs plane: Int32, height: Int32, layers: Int32, save: Boolean
# ---------- python_2: Python ----------
import rhinoscriptsyntax as rs

SelectedPlane = ['planeO', 'planeA', 'planeB']

SelectedPlane = SelectedPlane[plane]

height = str(height)
layers = str(layers)
speed = str(speed)

n = "W_CP_"+ height+ '_'+ layers+ '_'+ speed+ '_'+ SelectedPlane
n = n.replace('.', 'd')

name = str(n)
# ---------- end python_2 ----------
panel_2 = Panel(python_2.name)
kuka_prc = KUKAPrcCORE(
    SimulationSlider=number_slider,
    KUKAPrcCommands=dam,
    Tool=custom_tool_pln,
    Robot=cluster.robot_2,
    CollisionGeometry=collision,
    SaveToggle=python_2.save,
    Filename="M07_pB",
    PRC_BaseExpose=False,
    PRC_SaveNameExpose=True,
    PRCsettings="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")  # -> RobotGeometry, AnalysisOutput

# ----
# 3. Simulation, Analysis, Post-Processing
analysis = AnalysisKUKAPrc(KUKAPrcAnalysisData=kuka_prc.AnalysisOutput)  # -> RobotAxisValues, RobotCollisionCheck, RobotReachabilityCheck, CommandID, TimeValue, flatten(Planes), CommandTags, IOState, Index, KRL

模擬 = ValueList({"開": 0, "關": 1}, selected="關")
rec = DataRecorder(DataLimit=-10, RecordData=True)

pln = Plane(flatten(rec))
vsettings = CreateSettings(VoxelSize=Slider(8, range=0..100), Bandwidth=1, Isovalue=0, Adaptivity=0.1)
nurbs = NurbsCurve(Vertices=pln, Degree=3, Periodic=False)  # -> Curve, Length, Domain
# 4. Visualization
data_2 = Data(world_visual)
data_3 = Data([cluster_2.C, box])
# Robot Workspace
swatch = ColourSwatch(SwatchColor=RGBA(230, 170, 87, 212))
wires = BrepWireframe(Brep=data_2, Density=-1)
data_4 = Data(cluster_2.srf_2)
data_5 = Data(cluster_2.C)
wires_2 = BrepWireframe(Brep=data_3, Density=-1)
vcurve = CurveToVolume(Curves=nurbs.Curve, CurveRadius=Slider(20, range=0..100), Settings=vsettings)
preview = CustomPreview(Geometry=data_4, Material=swatch)
preview_2 = CustomPreview(Geometry=data_5, Material=ColourSwatch(SwatchColor=RGB(255, 0, 0)))
preview_3 = CustomPreview(Geometry=wires, Material=ColourSwatch(SwatchColor=RGB(0, 0, 0)))
preview_4 = CustomPreview(Geometry=data_2, Material=ColourSwatch(SwatchColor=RGBA(255, 255, 255, 16)))
preview_5 = CustomPreview(Geometry=vcurve, Material=ColourSwatch(SwatchColor=RGB(153, 153, 153)))
preview_6 = CustomPreview(Geometry=wires_2, Material=ColourSwatch(SwatchColor=RGB(255, 255, 255)))

# ==== cluster Cluster
geo = Geometry(flatten([<brep referenced from the Rhino model> x622]))
smooth = SettingsQuality()
holder = Mesh([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])
join = BrepJoin(Breps=holder)  # -> Breps, Closed
mesh = MeshBrep(
    Brep=holder,
    Settings={GridMaxCount=0, GridMinCount=16, JaggedSeams=False, MaxEdgeLength=0, MinEdgeLength=0.0001, MinTolerance=0, Refine=True, RefineAngle=0, RelativeTolerance=0.65, SimplePlanes=True, Tolerance=0})
mjoin = MeshJoin(Meshes=holder)
panel = Panel(mjoin)
kr90_kr270_r2500 = QuantecKR90KR270R2500Robot(infiniterot=False)
panel_2 = Panel("""37.5
2403.3
-2.0
0.0
90.0
-0.1812""")
panel_3 = Panel("""37.0714
2402.8586
-2.0
0.2993
0.0052
0.0001""")
panel_4 = Panel("""0.0
-2400.0
0.0
0.0
90.0
0.0""")
panel_5 = Panel("""-2.06
-2400.320
0
0.01421
-0.0074
0.00""")
west_platform = Mesh(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)
east_platform = Mesh(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)
panel_6 = Panel("""675.0
350.0
1150.0
1000.0
-41.0
240.0""")
rail = Mesh(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)
e1_min = Panel("0")
e1_max = Panel("4270")
item = ListItem(List=panel_4, Index=0, Wrap=True)  # -> Item, Item1, Item2, Item3, Item4, Item5
item_2 = ListItem(List=panel_5, Index=0, Wrap=True)  # -> Item, Item1, Item2, Item3, Item4, Item5
item_3 = ListItem(List=panel_2, Index=0, Wrap=True)  # -> Item, Item1, Item2, Item3, Item4, Item5
item_4 = ListItem(List=panel_3, Index=0, Wrap=True)  # -> Item, Item1, Item2, Item3, Item4, Item5
custom_robot = CustomRobot(ReferenceRobot=kr90_kr270_r2500, RobotName="KR300-R2500", Layout=panel_6)
frame = FrameKUKAPrc(
    FrameNumber=0,
    XValue=item.Item,
    YValue=item.Item1,
    ZValue=item.Item2,
    AValue=item.Item3,
    BValue=item.Item4,
    CValue=item.Item5,
    toolaxis="X")  # -> KUKAPrcFrame, XYZABCAsPlane
frame_2 = FrameKUKAPrc(
    FrameNumber=0,
    XValue=item_2.Item,
    YValue=item_2.Item1,
    ZValue=item_2.Item2,
    AValue=item_2.Item3,
    BValue=item_2.Item4,
    CValue=item_2.Item5,
    toolaxis="Z")  # -> KUKAPrcFrame, XYZABCAsPlane
frame_3 = FrameKUKAPrc(
    FrameNumber=0,
    XValue=item_3.Item,
    YValue=item_3.Item1,
    ZValue=item_3.Item2,
    AValue=item_3.Item3,
    BValue=item_3.Item4,
    CValue=item_3.Item5,
    toolaxis="X")  # -> KUKAPrcFrame, XYZABCAsPlane
frame_4 = FrameKUKAPrc(
    FrameNumber=0,
    XValue=item_4.Item,
    YValue=item_4.Item1,
    ZValue=item_4.Item2,
    AValue=item_4.Item3,
    BValue=item_4.Item4,
    CValue=item_4.Item5,
    toolaxis="Z")  # -> KUKAPrcFrame, XYZABCAsPlane
deplane = DeconstructPlane(Plane=frame.XYZABCAsPlane)  # -> Origin, XAxis, YAxis, ZAxis
deplane_2 = DeconstructPlane(Plane=frame_3.XYZABCAsPlane)  # -> Origin, XAxis, YAxis, ZAxis
move = Move(Motion=Vector(0, 0, 10))  # -> Geometry, Transform
orient = Orient(Geometry=west_platform, Source=PlaneXY(0, 0, 0), Target=frame_2.XYZABCAsPlane)  # -> Geometry, Transform
orient_2 = Orient(Geometry=rail, Source=PlaneXY(0, 0, 0), Target=frame_2.XYZABCAsPlane)  # -> Geometry, Transform
orient_3 = Orient(Geometry=rail, Source=PlaneXY(0, 0, 0), Target=frame_4.XYZABCAsPlane)  # -> Geometry, Transform
orient_4 = Orient(Geometry=east_platform, Source=PlaneXY(0, 0, 0), Target=frame_4.XYZABCAsPlane)  # -> Geometry, Transform
orient_5 = Orient(Geometry=holder, Source=PlaneXY(0, 0, 0), Target=frame_4.XYZABCAsPlane)  # -> Geometry, Transform
panel_7 = Panel(orient_4.Geometry)
custom_rail = CustomLinearAxisKUKAPrc(
    KUKAPrcRobotInput=custom_robot,
    RobotRail=orient_3.Geometry,
    RobotPlatform=orient_4.Geometry,
    PositiveLength=e1_max,
    NegativeLength=e1_min,
    PositiveDirection=deplane_2.XAxis,
    RobotBase=frame_4.XYZABCAsPlane)
custom_rail_2 = CustomLinearAxisKUKAPrc(
    KUKAPrcRobotInput=custom_robot,
    RobotRail=orient_2.Geometry,
    RobotPlatform=orient.Geometry,
    PositiveLength=e1_max,
    NegativeLength=e1_min,
    PositiveDirection=deplane.XAxis,
    RobotBase=frame_2.XYZABCAsPlane)
robot = ClusterOutput(custom_rail_2)
robot_2 = ClusterOutput(custom_rail)

# ==== cluster IO
toggle = BooleanToggle(False)
toggle_2 = BooleanToggle(True)
digital_out = DigitalOutputKUKAPrc(DigitalOutputNumber="1", OutputState=toggle_2, ContinuousMovement=toggle_2, ToolState=-1)
digital_out_2 = DigitalOutputKUKAPrc(DigitalOutputNumber="1", OutputState=toggle, ContinuousMovement=toggle_2, ToolState=-1)
digital_out_3 = DigitalOutputKUKAPrc(DigitalOutputNumber="2", OutputState=toggle_2, ContinuousMovement=toggle_2, ToolState=-1)
digital_out_4 = DigitalOutputKUKAPrc(DigitalOutputNumber="3", OutputState=toggle_2, ContinuousMovement=toggle_2, ToolState=-1)
digital_out_5 = DigitalOutputKUKAPrc(DigitalOutputNumber="2", OutputState=toggle, ContinuousMovement=toggle_2, ToolState=-1)
digital_out_6 = DigitalOutputKUKAPrc(DigitalOutputNumber="3", OutputState=toggle, ContinuousMovement=toggle_2, ToolState=-1)
merge = Merge(Data1=digital_out_2, Data2=digital_out_5, Data3=digital_out_6)
merge_2 = Merge(Data1=digital_out, Data2=digital_out_5, Data3=digital_out_6)
merge_3 = Merge(Data1=digital_out_2, Data2=digital_out_3, Data3=digital_out_6)
merge_4 = Merge(Data1=digital_out_2, Data2=digital_out_5, Data3=digital_out_4)
entwine = Entwine(Branch0X=merge, Branch1X=merge_2, Branch2X=merge_3, Branch3X=merge_4, FlattenInputs=False)  # -> simplify(Result)
bang = ExplodeTree(Data=entwine)  # -> flatten(Branch0), flatten(Branch1), flatten(Branch2), flatten(Branch3)
_0 = ClusterOutput(bang.Branch0)
_1 = ClusterOutput(bang.Branch1)
_2 = ClusterOutput(bang.Branch2)
_3 = ClusterOutput(bang.Branch3)

# ==== cluster Cluster_2
data = ClusterInput()
O = ClusterInput()
X = ClusterInput()
plane = Plane(Plane(origin=(107, 819, -453), x=(0.999936913, -0.01083675472, 0.00295547856), y=(0.01083708922, 0.9999412723, -9.718915386e-05)))
plane_a = Plane(Plane(origin=(-487, 831, -435), x=(0.9997123019, -0.02392473885, -0.001708909918), y=(0.02390597081, 0.999661481, -0.01026781271)))
plane_b = Plane(Plane(origin=(739, 802, -435), x=(0.999928172, -0.01198544042, 0), y=(0.01198501305, 0.9998925174, -0.008444712633)))
data_2 = Data(data)
panel = Panel("""2400
1200""")
panel_2 = Panel("""1200
1200""")
filter = StreamFilter(Gate=data_2, Stream0=plane, Stream1=plane_a, Stream2=plane_b)
filter_2 = StreamFilter(Gate=data_2, Stream0=panel, Stream1=panel_2, Stream2=panel_2)
item = ListItem(List=filter_2, Index=0, Wrap=True)  # -> Item, Item1
pl_offset = PlaneOffset(BasePlane=filter, Offset=O)
planesrf = PlaneSurface(Plane=pl_offset, XSize=item.Item, YSize=item.Item1)
area = Area(Geometry=planesrf)  # -> Area, Centroid
neg = Negative(Value=Slider(100, range=0..100))
orient = Orient(Geometry=planesrf, Source=area.Centroid, Target=pl_offset)  # -> Geometry, Transform
vec = VectorXYZ(XComponent=X, YComponent=X, ZComponent=0)  # -> Vector, Length
move = Move(Geometry=pl_offset, Motion=vec.Vector)  # -> Geometry, Transform
offset_l = OffsetCurveLoose(Curve=orient.Geometry, Distance=neg)
srf = Surface(orient.Geometry)
panel_3 = Panel(move.Geometry)
G = ClusterOutput(move.Geometry)
srf_2 = ClusterOutput(srf)
C = ClusterOutput(offset_l)
